# Grasshopper definition DuneWorm_Example File.gh (Grasshopper 1.0.7)
# plug-ins: GhcDuneField

panel = Panel("01 Default Input")
panel_2 = Panel("02 Image Input")
panel_3 = Panel("03 Simulation Example")
number_slider = Slider(64, range=0..96)
curve = Curve(<curve referenced from the Rhino model>)
vector = Vector(curve)
number_slider_2 = Slider(64, range=0..100)  # disabled
panel_4 = Panel(vector)
ghcsetupfield = GhcSetUpField(Width=number_slider, Length=number_slider, InitialHeight=Slider(3, range=0..10), RandomHeight=Toggle(False))
boolean_toggle = BooleanToggle(False)  # disabled
curve_2 = Curve(<curve referenced from the Rhino model>)
trigger = Trigger(Interval=1, TimerInterval=5, Target=ghcdunefieldcomponent)  # disabled
ghcsetupfield_2 = GhcSetUpField(Width=Slider(96, range=0..100), Length=Slider(64, range=0..100), InitialHeight="6", RandomHeight=Toggle(False))
vector_2 = Vector(curve_2)
panel_5 = Panel(vector_2)
ghcsetupfield_3 = GhcSetUpField(Width=number_slider_2, Length=number_slider_2, InitialHeight=4, RandomHeight=boolean_toggle)  # disabled
ghcdunefieldcomponent = GhcDuneFieldComponent(StartingField=ghcsetupfield, Reset=Button(), WindDir=panel_4)  # -> ShadowValues, ShadowValuesDebugger, HeightValuesDebugger, DuneFieldPoints; disabled
trigger_2 = Trigger(Interval=1, TimerInterval=5, Target=ghcdunefieldcomponent_2)  # disabled
image_sampler = ImageSampler(
    ghcsetupfield_3,
    FilePath="D:\[Data]\[Side Project]\DuneField\[Icon]\Input HeightField.png",
    Filter="Value",
    Interpolate=False,
    Umax=64,
    Umin=0,
    Vmax=64,
    Vmin=0,
    Wrap=1)  # disabled
ghcdunefieldcomponent_2 = GhcDuneFieldComponent(StartingField=ghcsetupfield_2, Reset=Button(), WindDir=panel_5)  # -> ShadowValues, ShadowValuesDebugger, HeightValuesDebugger, DuneFieldPoints; disabled
cluster = Cluster(shadow_values=ghcdunefieldcomponent.ShadowValues, point=ghcdunefieldcomponent.DuneFieldPoints)  # -> colour, colour_2, patch_2, colour_swatch
number_slider_3 = Slider(20, range=0..100)  # disabled
multiplication = Multiplication(A=image_sampler, B=number_slider_3)  # disabled
point = Point(ghcdunefieldcomponent_2.DuneFieldPoints)
heightmap = CustomPreview(Material=cluster.colour)
wind_shadow = CustomPreview(Material=cluster.colour_2)
brep_output = CustomPreview(Geometry=cluster.patch_2, Material=cluster.colour_swatch)
unit_z = UnitZ(Factor=multiplication)  # disabled
cluster_2 = Cluster(shadow_values=ghcdunefieldcomponent_2.ShadowValues, point=ghcdunefieldcomponent_2.DuneFieldPoints)  # -> colour, colour_2, patch_2, colour_swatch
patch = Patch(Points=ghcdunefieldcomponent_2.DuneFieldPoints, Spans="20", Flexibility=1, Trim=True)
curve_3 = Curve(<curve referenced from the Rhino model>)
move = Move(Geometry=ghcsetupfield_3, Motion=unit_z)  # -> Geometry, Transform; disabled
vector_3 = Vector(curve_3)
custom_preview = CustomPreview(Geometry=patch, Material=ColourSwatch(SwatchColor=RGB(227, 227, 227)))
heightmap_2 = CustomPreview(Geometry=point, Material=cluster_2.colour)
wind_shadow_2 = CustomPreview(Material=cluster_2.colour_2)
brep_output_2 = CustomPreview(Geometry=cluster_2.patch_2, Material=cluster_2.colour_swatch)  # disabled
panel_6 = Panel(vector_3)
button = Button()  # disabled
trigger_3 = Trigger(Interval=1, TimerInterval=5, Target=ghcdunefieldcomponent_3)  # disabled
ghcdunefieldcomponent_3 = GhcDuneFieldComponent(StartingField=move.Geometry, Reset=button, WindDir=panel_6)  # -> ShadowValues, ShadowValuesDebugger, HeightValuesDebugger, DuneFieldPoints; disabled
cluster_3 = Cluster(shadow_values=ghcdunefieldcomponent_3.ShadowValues, point=ghcdunefieldcomponent_3.DuneFieldPoints)  # -> colour, colour_2, patch_2, colour_swatch; disabled
heightmap_3 = CustomPreview(Material=cluster_3.colour)  # disabled
wind_shadow_3 = CustomPreview(Material=cluster_3.colour_2)  # disabled
brep_output_3 = CustomPreview(Geometry=cluster_3.patch_2, Material=cluster_3.colour_swatch)  # disabled

# ==== cluster Cluster
shadow_values = ClusterInput()
point = ClusterInput()
point_2 = Point(point)
wind_shadow_debugger = WindShadowDebugger(parameter=shadow_values)
height_debugger = HeightDebugger(point=point_2)
colour = ClusterOutput(height_debugger)
colour_2 = ClusterOutput(wind_shadow_debugger)
point_3 = Point(point_2)
patch = Patch(Points=point_3, Spans=20, Flexibility=1, Trim=True)
patch_2 = ClusterOutput(patch)
colour_swatch = ClusterOutput(ColourSwatch(SwatchColor=RGB(212, 212, 212)))

# ==== cluster HeightDebugger
point = ClusterInput()
deconstruct = Deconstruct(Point=point)  # -> XComponent, YComponent, flatten(ZComponent)
bounds = Bounds(Numbers=deconstruct.ZComponent)
deconstruct_domain = DeconstructDomain(Domain=bounds)  # -> Start, End
panel = Panel("0")
panel_2 = Panel("10")
gradient = Gradient(
    LowerLimit=deconstruct_domain.Start,
    UpperLimit=deconstruct_domain.End,
    Parameter=deconstruct.ZComponent,
    stops=[0.0313: RGB(0, 0, 0), 0.327: RGB(192, 0, 192), 0.509: RGB(0, 0, 255), 0.669: RGB(79, 186, 8), 0.785: RGB(220, 237, 32), 0.876: RGB(247, 159, 20), 1: RGB(243, 57, 0)])
gradient_2 = Gradient(
    LowerLimit=deconstruct_domain.Start,
    UpperLimit=deconstruct_domain.End,
    Parameter=deconstruct.ZComponent,
    stops=[0.0313: RGB(0, 0, 0), 0.18: RGB(192, 0, 192), 0.306: RGB(0, 0, 255), 0.44: RGB(0, 255, 255), 0.558: RGB(0, 128, 0), 0.677: RGB(79, 186, 8), 0.806: RGB(220, 237, 32), 0.915: RGB(247, 159, 20), 1: RGB(243, 57, 0)])
colour = ClusterOutput(gradient)

# ==== cluster WindShadowDebugger
parameter = ClusterInput()
bounds = Bounds(Numbers=parameter)
deconstruct_domain = DeconstructDomain(Domain=bounds)  # -> Start, End
gradient = Gradient(
    LowerLimit=deconstruct_domain.Start,
    UpperLimit=deconstruct_domain.End,
    Parameter=parameter,
    stops=[0: RGB(255, 0, 0), 0.71: RGB(0, 0, 0)])
colour = ClusterOutput(gradient)
